# Grasshopper definition sketch.gh (Grasshopper 1.0.7)

number_slider = Slider(22, range=0..100)
number_slider_2 = Slider(24, range=0..100)
number_slider_3 = Slider(0.325, range=0..1)

# ---- group: Geo: Triangle
pt = ConstructPoint(XCoordinate=0, YCoordinate=0, ZCoordinate=0)
pt_2 = ConstructPoint(XCoordinate=0, YCoordinate=0, ZCoordinate=0)
pt_3 = ConstructPoint(XCoordinate=number_slider_3, YCoordinate=0, ZCoordinate=0)
pt_4 = ConstructPoint(XCoordinate=0, YCoordinate=number_slider_3, ZCoordinate=0)
pt_5 = Point([pt_2, pt_3, pt_4, pt])
pline = PolyLine(Vertices=pt_5, Closed=False)
division = Division(A=number_slider_3, B=2)
X = UnitX(Factor=division)
division_2 = Division(A=number_slider_3, B=2)
rev = Reverse(Vector=X)
Y = UnitY(Factor=division_2)
move = Move(Geometry=pline, Motion=rev)  # -> Geometry, Transform
rev_2 = Reverse(Vector=Y)
move_2 = Move(Geometry=move.Geometry, Motion=rev_2)  # -> Geometry, Transform

# ----
series = Series(Start=0, Step=number_slider_3, Count=number_slider)
series_2 = Series(Start=0, Step=number_slider_3, Count=number_slider)
X_2 = UnitX(Factor=series)
number_slider_4 = Slider(360, range=0..1000)
pt_6 = ConstructPoint(XCoordinate=0, YCoordinate=0, ZCoordinate=0)
X_3 = UnitX(Factor=series_2)
series_3 = Series(Start=0, Step=number_slider_3, Count=number_slider_2)
series_4 = Series(Start=0, Step=number_slider_3, Count=number_slider_2)
move_3 = Move(Geometry=move_2.Geometry, Motion=X_2)  # -> graft(Geometry), Transform
move_4 = Move(Geometry=pt_6, Motion=X_3)  # -> graft(Geometry), Transform
Y_2 = UnitY(Factor=series_4)
Y_3 = UnitY(Factor=series_3)
division_3 = Division(A=number_slider_4, B=Slider(90, range=0..100))
move_5 = Move(Geometry=move_4.Geometry, Motion=Y_3)  # -> flatten(Geometry), Transform
move_6 = Move(Geometry=move_3.Geometry, Motion=Y_2)  # -> flatten(Geometry), Transform
range = Range(Domain=number_slider_4, Steps=division_3)
random = Random(Range=range, Number=Slider(4, range=0..10), Seed=Slider(3, range=0..10))  # -> flatten(Random)
lng = ListLength(List=range)
lng_2 = ListLength(List=move_6.Geometry)
division_4 = Division(A=lng_2, B=lng)
dup = DuplicateData(Data=range, Number=division_4, Order=True)
division_5 = Division(A=lng_2, B=Slider(9.6, range=0..10))
jitter = Jitter(List=dup, Jitter=1, Seed=Slider(7, range=0..10))  # -> Values, Indices
rotate = Rotate(Geometry=move_6.Geometry, Angle=degrees(jitter.Values), Plane=move_5.Geometry)  # -> Geometry, Transform
geo = Geometry(rotate.Geometry)

# ---- group: Bake it!
reduce = RandomReduce(List=geo, Reduction=division_5, Seed=Slider(7, range=0..10))
